# Grasshopper definition transform_revit_ecs_to_epsg-p2326-v5738.gh (Grasshopper 1.0.8)
# Copyright: Arup
# plug-ins: eleFront, Speckle.Connector.Grasshopper

speckle_model = SpeckleModel(
    Model="7f2a89be04",
    Project="34b188cb10",
    Server="https://app.speckle.systems",
    User="80EEB7BBE4744244BEF9F42A8D144D75",
    Workspace="b6415b8ed6")
speckle_model_2 = SpeckleModel(
    Model="55ab2430e5",
    Project="34b188cb10",
    Server="https://app.speckle.systems",
    User="80EEB7BBE4744244BEF9F42A8D144D75",
    Workspace="b6415b8ed6")
load = Load(SpeckleModel=speckle_model, AutoReceive=False)
load_2 = Load(SpeckleModel=speckle_model_2, AutoReceive=False)
arch_spklcollection = EleFrontDataDescription(load, ShiftDepth=0, isNameSet=True)
str_spklcollection = EleFrontDataDescription(load_2, ShiftDepth=0, isNameSet=True)
collection_selector = CollectionSelector(str_spklcollection, AutoSelectAllItems=False)
arch_spklcollection_2 = EleFrontDataDescription(arch_spklcollection, ShiftDepth=0, isNameSet=False)
str_spklcollection_2 = EleFrontDataDescription(str_spklcollection, ShiftDepth=0, isNameSet=False)
query_speckle_objects = QuerySpeckleObjects(Collection=arch_spklcollection_2)
query_speckle_objects_2 = QuerySpeckleObjects(Collection=str_spklcollection_2, Path=collection_selector)
# Error: 1. Data conversion failed from Speckle Block Instance to Speckle Data Object
speckle_data_object = SpeckleDataObject(SpeckleDataObject=query_speckle_objects_2)  # -> SpeckleDataObject, Geometries, Name, Properties, Path
# Error: 1. Data conversion failed from Speckle Block Instance to Speckle Block Definition
speckle_block_definition = SpeckleBlockDefinition(BlockDefinition=query_speckle_objects_2)  # -> BlockDefinition, Geometry, Name
